# Dynamo graph Execute_visualizeSelection.dyn (Dynamo 2.12.0.5650)
# packages: archi-lab.net 2022.210.1022

rerunnodes = Python()  # CPython3; unwired: IN[0]
# ---------- rerunnodes.python (83 lines) ----------
###############################################################
# Import general packages.
import clr
import sys
import math
import System
import io
import os
import importlib

# Import Revit/Dynamo API related packages.
clr.AddReference('DynamoRevitDS')
import Dynamo
from System import Array
from System.Collections.Generic import *
clr.AddReference("RevitNodes")
import Revit
clr.ImportExtensions(Revit.Elements)
clr.ImportExtensions(Revit.GeometryConversion)
clr.AddReference("RevitServices")
import RevitServices
from RevitServices.Persistence import DocumentManager 
from RevitServices.Transactions import TransactionManager 
clr.AddReference("RevitAPI")
clr.AddReference('ProtoGeometry')
import Autodesk 
from Autodesk.DesignScript.Geometry import *
from Autodesk.DesignScript import *
from Autodesk.Revit.DB import *
from Autodesk.Revit.DB import Parameter
from Autodesk.Revit.DB.Architecture import *
from Autodesk.Revit.DB import IFailuresPreprocessor

# Import external python packages.
localapp = os.getenv(r'LOCALAPPDATA')
sys.path.append(os.path.join(localapp, r'python-3.8.3-embed-amd64\Lib\site-packages'))

# Import customized python packgaes.
sys.path.append(r'C:\dev\phd\jw\healing\src\godyn')

import healBasics
importlib.reload(healBasics)
import healChecks
importlib.reload(healChecks)
import healParameters
importlib.reload(healParameters)

###############################################################
doc = DocumentManager.Instance.CurrentDBDocument


###############################################################
# Temporary functions


###############################################################
# Prepare the input (of the Python Node)
element = IN[0]


##############################################################
# Prepare the output (of the Python Node)
out = []


###############################################################
# Start Transaction in Revit
TransactionManager.Instance.EnsureInTransaction(doc)


###############################################################
# Main part
healBasics.rerunNodes()


###############################################################
# End Transaction in Revit
TransactionManager.Instance.TransactionTaskDone()


###############################################################
# End
OUT = out
# ----------------------------------------

# group: Tune the 3D graphics style.
current = Document.Current()  # frozen
activeView = Document.ActiveView(document=current)
setGraphicsStyle = Python(IN[0]=activeView)  # CPython3
# ---------- setGraphicsStyle.python (83 lines) ----------
###############################################################
# Import general packages.
import clr
import sys
import math
import System
import io
import os
import importlib

# Import Revit/Dynamo API related packages.
clr.AddReference('DynamoRevitDS')
import Dynamo
from System import Array
from System.Collections.Generic import *
clr.AddReference("RevitNodes")
import Revit
clr.ImportExtensions(Revit.Elements)
clr.ImportExtensions(Revit.GeometryConversion)
clr.AddReference("RevitServices")
import RevitServices
from RevitServices.Persistence import DocumentManager 
from RevitServices.Transactions import TransactionManager 
clr.AddReference("RevitAPI")
clr.AddReference('ProtoGeometry')
import Autodesk 
from Autodesk.DesignScript.Geometry import *
from Autodesk.DesignScript import *
from Autodesk.Revit.DB import *
from Autodesk.Revit.DB import Parameter
from Autodesk.Revit.DB.Architecture import *
from Autodesk.Revit.DB import IFailuresPreprocessor

# Import external python packages.
localapp = os.getenv(r'LOCALAPPDATA')
sys.path.append(os.path.join(localapp, r'python-3.8.3-embed-amd64\Lib\site-packages'))

# Import customized python packgaes.
sys.path.append(r'C:\dev\phd\jw\healing\src\godyn')

import healBasics
importlib.reload(healBasics)
import healChecks
importlib.reload(healChecks)
import healParameters
importlib.reload(healParameters)
import healVisual
importlib.reload(healVisual)

###############################################################
doc = DocumentManager.Instance.CurrentDBDocument


###############################################################
# Temporary functions


###############################################################
# Prepare the input (of the Python Node)
elements = UnwrapElement(IN[0])

##############################################################
# Prepare the output (of the Python Node)
out = []

###############################################################
# Start Transaction in Revit
TransactionManager.Instance.EnsureInTransaction(doc)


###############################################################
# Main part
out = healVisual.setGraphicsStyle(elements)


###############################################################
# End Transaction in Revit
TransactionManager.Instance.TransactionTaskDone()


###############################################################
# End
OUT = out
# ----------------------------------------

# group: Locate to the correct directory.
string = StringInput("C:\dev\phd\ModelHealer\ini\topo\")
string_2 = StringInput("neighbor_")
k_search_neighbor = DoubleInput(3)
string_from_object = FromObject(object=k_search_neighbor)
add = string_2 + string_from_object
add_2 = string + add
string_3 = StringInput("\")
add_3 = add_2 + string_3
string_4 = StringInput("IBC1020_2")
string_5 = StringInput("IBC1207_1")
string_6 = StringInput("IBC1207_3")
list_create = List.Create(item0=string_4, item1=string_5, item2=string_6)

# group: Select FloorPlan View according to related Rule Labels.
categories = Categories("OST_Views")
all_elements_of_category = ElementsOfCategory(Category=categories)
boolean = BoolSelector(false)
clean = List.Clean(list=all_elements_of_category, preserveIndices=boolean)
code_block = CodeBlock { "View Name"; }
getParameterValueByName = Element.GetParameterValueByName(element=clean, parameterName=code_block)
contains = String.Contains(string=getParameterValueByName, searchFor=list_create@L1)

# group: Visualize the Checking Failures and the Potential Neighbors.
string_7 = StringInput("res_ini_perrule_failure.csv")
add_4 = add_3 + string_7
string_8 = StringInput("res_ini_perrule_failureneighbor.csv")
add_5 = add_3 + string_8
visualizeSelection = Custom[visualizeSelection](CSVPathFailure=add_4, CSVPathFailureNeighbors=add_5, IBCRulesAsString=list_create, lacing=Longest)  # visualize the selected elements.
passThrough = Custom[PassThrough](passThrough=clean, waitFor=visualizeSelection)  # package archi-lab.net; Ripped this off from Clockwork. Sorry Andy.

# group (continued): Select FloorPlan View according to related Rule Labels.
filterByBoolMask = List.FilterByBoolMask(list=passThrough, mask=contains@L2)

# group: Export to PNG.
getParameterValueByName_2 = Element.GetParameterValueByName(element=filterByBoolMask.in, parameterName=code_block)
string_9 = StringInput(".png")
add_6 = getParameterValueByName_2 + string_9
add_7 = add + add_6
add_8 = add_3 + add_7
exportAsImage = View.ExportAsImage(view=filterByBoolMask.in, path=add_8)
